# Grasshopper definition Central_Park_Shadow_Study.gh (Grasshopper 0.9.76)
# plug-ins: Python Interpreter

panel = Panel("https://www.energyplus.net/weather-download/north_and_central_america_wmo_region_4/USA/NY/USA_NY_New.York.City-Central.Park.744860_TMY2/all")
ladybug = Ladybug_Ladybug()  # -> Vviiiiiiiiiizzz; plug-in component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
epw_stat = Ladybug_OpenEPWAndSTATWeatherFiles(weatherFileURL=panel)  # -> epwFile, statFile; plug-in component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

# ---- group: Timestep for analysis
number_slider = Slider(6, range=0..10)

# ---- group: park curves
crv = Curve([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])

# ----
importlocation = Ladybug_ImportLocation(epwFile=epw_stat.epwFile)  # -> location; plug-in component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
series = Series(Start="1", Step=1, Count="24")

# ---- group: Park
brep = Brep(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)

# ---- group: New York Buildings
ny_buildings = Brep([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])

# ----
# Generate Sunpath
# Dec 21st
sunpath = Ladybug_SunPath(
    location=importlocation,
    hour=series,
    day="21",
    month="12",
    timeStep=number_slider,
    sunPathScale=Slider(5, range=0..10),
    sunScale=Slider(0.5, range=0..1),
    dailyOrAnnualSunPath=True)  # -> readMe, sunVectors, sunAltitudes, sunAzimuths, port, sunSpheresMesh, sunPathCrvs, compassCrvs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; plug-in component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
number_slider_2 = Slider(5, range=0..10)

smesh = SimpleMesh(Brep=ny_buildings)
mjoin = MeshJoin(Meshes=smesh)

wires = BrepWireframe(Brep=ny_buildings, Density=-1)
ext = ExtendCurve(Curve=wires, Type=0, Start=number_slider_2, End=number_slider_2)
preview = CustomPreview(Geometry=mjoin, Shader=ColourSwatch(SwatchColor=RGBA(255, 255, 255, 116)))
toggle = BooleanToggle(False)
sunlighthoursanalysis = Ladybug_SunlightHoursAnalysis(
    geometry=flatten(brep),
    context=flatten(mjoin),
    gridSize="10",
    disFromBase=".01",
    sunVectors=flatten(sunpath.sunVectors),
    timeStep=number_slider,
    parallel=toggle,
    runIt=toggle)  # -> readMe, contextMesh, analysisMesh, testPts, testVec, port, sunlightHoursResult, sunlightHoursMesh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; plug-in component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
minimum_hours_needed = Panel("4")
mesh = Mesh(sunlighthoursanalysis.sunlightHoursMesh)
smaller = SmallerThan(FirstNumber=sunlighthoursanalysis.sunlightHoursResult, SecondNumber=minimum_hours_needed)  # -> SmallerThan, OrEqualTo
dispatch = Dispatch(List=sunlighthoursanalysis.testPts, DispatchPattern=smaller.SmallerThan)  # -> ListA, ListB
dispatch_2 = Dispatch(List=sunlighthoursanalysis.sunlightHoursResult, DispatchPattern=smaller.SmallerThan)  # -> ListA, ListB

# ---- group: Number of hours missing
subtraction = Subtraction(A=minimum_hours_needed, B=dispatch_2.ListA)  # -> simplify(graft(Result))

# ---- group: problematic points
pt = Point(graft(dispatch.ListA))

# ----
multiplication = Multiplication(A=subtraction, B=number_slider)
mjoin_2 = MeshJoin(Meshes=sunlighthoursanalysis.contextMesh)

# ----
# Find blocked vectors for problematic points and sort them based on angle
viewer = ParamViewer(sunlighthoursanalysis.sunIsVisible)
dispatch_3 = Dispatch(List=viewer, DispatchPattern=smaller.SmallerThan)  # -> ListA, ListB

# ---- group: filter branches for problematic points
branch = TreeBranch(Tree=sunlighthoursanalysis.sunIsVisible, Path=dispatch_3.ListA, MaintainPaths=False)

# ----
dispatch_4 = Dispatch(List=sunpath.sunAltitudes, DispatchPattern=branch)  # -> ListA, ListB
dispatch_5 = Dispatch(List=sunpath.sunVectors, DispatchPattern=branch)  # -> ListA, ListB

# ---- group: blocked vectors
vec = Vector(dispatch_5.ListB)

# ---- group: sort vectors based on altitude
sort = SortList(Keys=dispatch_4.ListB, ValuesA=vec)  # -> Keys, ValuesA

# ---- group: we want to select the ones with the largest degree
rev = ReverseList(List=sort.ValuesA)  # -> simplify(List)

# ----
split = SplitList(List=rev, Index=multiplication)  # -> simplify(ListA), ListB

# ---- group: Here are the vectors that should not be blocked
# Shoot the vectors back to buildings to find problematic areas of buildings
vec_2 = Vector(split.ListA)

# ----
rev_2 = Reverse(Vector=vec_2)
meshray = MeshRay(Mesh=mjoin_2, Point=pt, Direction=rev_2)  # -> Point, Hit
pt_2 = Point(meshray.Point)
devec = DeconstructVector(Vector=flatten(pt_2))  # -> XComponent, YComponent, ZComponent

# ---- group: visualization
plfit = PlaneFit(Points=flatten(pt_2))  # -> Plane, Deviation
hull = ConvexHull(Points=flatten(pt_2), Plane=plfit.Plane)  # -> Hull, HullZ, Indices
boundary = BoundarySurfaces(Edges=hull.Hull)
preview_2 = CustomPreview(Geometry=pt_2, Shader=ColourSwatch(SwatchColor=RGB(255, 0, 0)))
preview_3 = CustomPreview(Geometry=boundary, Shader=ColourSwatch(SwatchColor=RGBA(219, 206, 0, 142)))

# ----
bnd = Bounds(Numbers=devec.ZComponent)
panel_2 = Panel(bnd)
