# Grasshopper definition Create_3D_visualization_with_contour_curves_for_Ladybug_and_Honeybee.gh (Grasshopper 0.9.76)
# plug-ins: Python Interpreter

values_to_be_contour = Panel("""2
3
4
5
6
7
8""")
ladybug = Ladybug_Ladybug()  # -> Vviiiiiiiiiizzz; plug-in component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

# ---- group: range for zValues in 3D mesh in document units
panel = Panel("0")
panel_2 = Panel("5")

# ---- group: analysis results
num = Number([0, 0, 0, 0, 0, 0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])

# ---- group: Ladybug or Honeybee result mesh
mesh = Mesh(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)

# ----
bnd = Bounds(Numbers=num)
dom = ConstructDomain(DomainStart=panel, DomainEnd=panel_2)
panel_3 = Panel(bnd)

# ---- group: Create 3D Mesh
gradientlibrary = Ladybug_GradientLibrary(gradIndex="1")  # -> customColors; plug-in component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
legendpar = Ladybug_LegendParameters(numSegments="4", customColors=flatten(gradientlibrary))  # -> legendPar; plug-in component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
# 3D Mesh
recolormesh = Ladybug_RecolorMesh(
    analysisResult=num,
    inputMesh=mesh,
    heightDomain=dom,
    legendPar=legendpar,
    analysisTitle="sunlight hours",
    legendTitle="hours")  # -> readMe, newMesh, newLegend, legendBasePt, meshColors, legendColors; plug-in component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

# ---- group: generate intersection curves
bnd_2 = Bounds(Numbers=num)
remap = RemapNumbers(Value=values_to_be_contour, Source=bnd_2, Target=dom)  # -> Mapped, Clipped
swatch = ColourSwatch(SwatchColor=RGB(0, 0, 0))
contour = ContourEx(Shape=recolormesh.newMesh, Plane=PlaneXY(0, 0, 0), Offsets=remap.Mapped)
curvepoint = PointOnCurve(contour, parameter=0.5)
graft = GraftTree(Tree=values_to_be_contour, IncludeEmptyLists=True, IncludeNullItems=True)
tag = TextTag3D(Location=curvepoint, Text=graft, Size=1, Colour=swatch, Justification=7)

# ---- group: generate intersection curves / optional to make curves smoother
# Curves
smoothpline = SmoothPolyline(Polyline=contour, Strength=1, Times=1)

# ---- group: generate intersection curves (continued)
preview = CustomPreview(Geometry=smoothpline, Shader=swatch)
