# Grasshopper definition Cumulative_Radiation_Analysis_w_Ladybug.gh (Grasshopper 0.9.76)
# plug-ins: Python Interpreter

ladybug = Ladybug_Ladybug()  # -> Vviiiiiiiiiizzz; plug-in component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
panel = Panel("https://www.energyplus.net/weather-download/north_and_central_america_wmo_region_4/USA/PA/USA_PA_Philadelphia.Intl.AP.724080_TMY3/all")
epw_stat = Ladybug_OpenEPWAndSTATWeatherFiles(weatherFileURL=panel)  # -> epwFile, statFile; plug-in component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
brep = Brep([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])
test_surface = Brep(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)
wires = BrepWireframe(Brep=brep, Density=-1)
preview = CustomPreview(Geometry=brep, Shader=ColourSwatch(SwatchColor=RGB(255, 255, 255)))
preview_2 = CustomPreview(Geometry=test_surface, Shader=ColourSwatch(SwatchColor=RGBA(255, 255, 255, 223)))
gencumulativeskymtx = Ladybug_GenCumulativeSkyMtx(epwFile=epw_stat.epwFile, skyDensity=0, useOldRes=True, runIt=Toggle(False))  # -> readMe, cumulativeSkyMtx; plug-in component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
# Create the sky
selectskymtx = Ladybug_selectSkyMtx(cumulativeSkyMtx=gencumulativeskymtx.cumulativeSkyMtx, removeDiffuse=False, removeDirect=False)  # -> readMe, selectedSkyMtx; plug-in component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
# Run the analysis
# This model has +36000 test points and
# will take around 3 minutes to run!
radiationanalysis = Ladybug_RadiationAnalysis(
    north=0,
    geometry=flatten(test_surface),
    context=flatten(brep),
    gridSize=Slider(4, range=0..10),
    disFromBase=Slider(0.001, range=0..0.001),
    selectedSkyMtx=flatten(selectskymtx.selectedSkyMtx),
    parallel=Toggle(True),
    runIt=Toggle(False))  # -> readMe, contextMesh, analysisMesh, testPts, testVec, port, radiationResult, radiationMesh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; plug-in component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

# ---- group: make the mesh 3D
# You don't really need this!
# I wanted to show you how to create a 3d mesh.
dom = ConstructDomain(DomainStart=0, DomainEnd="30")

# ----
recolormesh = Ladybug_RecolorMesh(
    analysisResult=radiationanalysis.radiationResult,
    inputMesh=radiationanalysis.radiationMesh,
    heightDomain=dom,
    analysisTitle="Cumulative Radiation Analysis",
    legendTitle="kWh/m2")  # -> readMe, newMesh, newLegend, legendBasePt, meshColors, legendColors; plug-in component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
