# Grasshopper definition Customize_weather_data_visualization_with_3D_Chart.gh (Grasshopper 0.9.76)
# plug-ins: Python Interpreter

panel = Panel("https://www.energyplus.net/weather-download/north_and_central_america_wmo_region_4/USA/MD/USA_MD_Baltimore-Washington.Intl.AP.724060_TMY3/all")
ladybug = Ladybug_Ladybug()  # -> Vviiiiiiiiiizzz; plug-in component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
path = FilePath("C:\EnergyPlusV8-3-0\WeatherData\USA_IL_Chicago-OHare.Intl.AP.725300_TMY3.epw")
panel_2 = Panel(path)
panel_3 = Panel(ladybug)
epw_stat = Ladybug_OpenEPWAndSTATWeatherFiles(weatherFileURL=panel)  # -> epwFile, statFile; plug-in component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
panel_4 = Panel(epw_stat.epwFile)
importepw = Ladybug_ImportEpw(epwFile=epw_stat.epwFile)  # -> readMe, latitude, location, dryBulbTemperature, dewPointTemperature, relativeHumidity, windSpeed, windDirection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; plug-in component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
panel_5 = Panel(importepw.dryBulbTemperature)
gradientlibrary = Ladybug_GradientLibrary(gradIndex="6")  # -> customColors; plug-in component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
gradientlibrary_2 = Ladybug_GradientLibrary(gradIndex="1")  # -> customColors; plug-in component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
panel_6 = Panel("""-15
0""")
entwine = Entwine(Branch00=gradientlibrary_2, Branch01=gradientlibrary, FlattenInputs=True)  # -> simplify(Result)
graft = GraftTree(Tree=panel_6, IncludeEmptyLists=True, IncludeNullItems=True)
legendpar = Ladybug_LegendParameters(lowBound=graft, customColors=entwine)  # -> legendPar; plug-in component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

# ---- group: make graph 2D
panel_7 = Panel("0")

# ----
_3dchart = Ladybug_3DChart(
    inputData=flatten([importepw.dryBulbTemperature, importepw.relativeHumidity]),
    xScale=".25",
    zScale=panel_7,
    legendPar=legendpar)  # -> readMe, graphMesh, graphCurves, legend, legendBasePts, title, titleBasePts, dataPts, conditionalHOY; plug-in component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
