# Dynamo graph 00_importEpw.dyn (Dynamo 1.3.0.875)

# group: Select an epw weather file. If you don't have any epw files you can download one from epwmap: http://mostapharoudsari.github.io/epwmap/
file_path = Filename("..\..\..\..\..\..\EnergyPlusV8-6-0\WeatherData\USA_CO_Golden-NREL.724666_TMY3.epw")

import_epw = Custom[Import EPW](epwFile=file_path)  # Import epw. -
watch = Watch(import_epw.ERRReport)
analysis_period = Custom[Analysis Period]()  # Create a Ladybug Analysis Period
watch_2 = Watch(analysis_period.hoys)
watch_3 = Watch(analysis_period.dates)
watch_4 = Watch(analysis_period.analysisPeriod)
import_location = Custom[Import Location](epwFile=file_path)  # Import location data from an epw weather file
deconstruct_location = Custom[Deconstruct Location](location=import_location.location)  # Get different location data from a location string
construct_location = Custom[Construct Location](name=deconstruct_location.name, latitude=deconstruct_location.latitude, longitude=deconstruct_location.longitude, timeZone=deconstruct_location.timeZone, elevation=deconstruct_location.elevation)  # Construct a Ladybug location based on input data
watch_5 = Watch(construct_location.location)
watch_6 = Watch(import_epw.dryBulbTemperature)
