# Grasshopper definition Import_weather_data.gh (Grasshopper 0.9.76)
# plug-ins: Python Interpreter

panel = Panel("https://www.energyplus.net/weather-download/north_and_central_america_wmo_region_4/USA/PA/USA_PA_Philadelphia.Intl.AP.724080_TMY3/all")
ladybug = Ladybug_Ladybug()  # -> Vviiiiiiiiiizzz; plug-in component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
path = FilePath("C:\EnergyPlusV8-3-0\WeatherData\USA_IL_Chicago-OHare.Intl.AP.725300_TMY3.epw")
panel_2 = Panel(path)
panel_3 = Panel(ladybug)
epw_stat = Ladybug_OpenEPWAndSTATWeatherFiles(weatherFileURL=panel)  # -> epwFile, statFile; plug-in component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
panel_4 = Panel(epw_stat.epwFile)
importepw = Ladybug_ImportEpw(epwFile=epw_stat.epwFile)  # -> readMe, latitude, location, dryBulbTemperature, dewPointTemperature, relativeHumidity, windSpeed, windDirection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; plug-in component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
panel_5 = Panel(importepw.dryBulbTemperature)
_3dchart = Ladybug_3DChart(
    inputData=flatten([importepw.dryBulbTemperature, importepw.dewPointTemperature, importepw.windSpeed]),
    xScale="0.25",
    zScale="1.2")  # -> readMe, graphMesh, graphCurves, legend, legendBasePts, title, titleBasePts, dataPts, conditionalHOY; plug-in component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
