# Grasshopper definition Mapping_annual_data_on_sun_path.gh (Grasshopper 0.9.76)
# plug-ins: Python Interpreter

panel = Panel("https://www.energyplus.net/weather-download/north_and_central_america_wmo_region_4/USA/PA/USA_PA_Philadelphia.Intl.AP.724080_TMY3/all")
ladybug = Ladybug_Ladybug()  # -> Vviiiiiiiiiizzz; plug-in component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
panel_2 = Panel(ladybug)
epw_stat = Ladybug_OpenEPWAndSTATWeatherFiles(weatherFileURL=panel)  # -> epwFile, statFile; plug-in component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
importepw = Ladybug_ImportEpw(epwFile=epw_stat.epwFile)  # -> readMe, latitude, location, dryBulbTemperature, dewPointTemperature, relativeHumidity, windSpeed, windDirection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; plug-in component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
# Connect to conditionalStatement
# to filter sun positions with
# dryBulbTemperature > 20 C
panel_3 = Panel("a > 20")
panel_4 = Panel("""6
9
12""")
series = Series(Start="1", Step=1, Count="24")
sunpath = Ladybug_SunPath(
    location=importepw.location,
    hour=series,
    day=21,
    month=panel_4,
    timeStep=1,
    sunPathScale=Slider(3, range=0..10),
    annualHourlyData=flatten(importepw.dryBulbTemperature),
    dailyOrAnnualSunPath=True)  # -> readMe, sunVectors, sunAltitudes, sunAzimuths, port, sunSpheresMesh, sunPathCrvs, compassCrvs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; plug-in component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
Z = UnitZ(Factor="30")
ln = Line(StartPoint=sunpath.sunPathCenPts, EndPoint=sunpath.sunPositions)
move = Move(Geometry=sunpath.sunPositions, Motion=Z)  # -> Geometry, Transform

# ---- group: geometries / context
brep = Brep([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])

# ---- group: geometries
number_slider = Slider(4.4, range=0..10)
wires = BrepWireframe(Brep=brep, Density=-1)
ext = ExtendCurve(Curve=wires, Type=0, Start=number_slider, End=number_slider)
preview = CustomPreview(Geometry=ext, Shader=ColourSwatch(SwatchColor=RGB(0, 0, 0)))
preview_2 = CustomPreview(Geometry=brep, Shader=ColourSwatch(SwatchColor=RGBA(255, 255, 255, 144)))

# ----
tag = TextTag(Location=move.Geometry, Text=sunpath.sunPositionsInfo)
