# Grasshopper definition Remove_Ladybug_and_Honeybee.gh (Grasshopper 1.0.7)

# ---- group: set to true to remove the old version
toggle = BooleanToggle(False)

# ----
removehb = RemoveHB(removeHB=toggle)
# ---------- removehb: Python ----------
import sys
import os
from distutils import dir_util
import Grasshopper.Folders as folders

ghenv.Component.Name = "RemoveHB"
ghenv.Component.NickName = "RemoveHB"
ghenv.Component.Description = "This component helps you to reomeve old versions of Ladybug and Honeybee"


def nukedir(target_dir, rmdir=False):
    """Delete all the files inside target_dir.

    This function has been copied from ladybug.futil.
    """
    d = os.path.normpath(target_dir)
    if not os.path.isdir(d):
        return

    files = os.listdir(d)
    for f in files:
        if f == '.' or f == '..':
            continue
        path = os.path.join(d, f)
        if os.path.isdir(path):
            nukedir(path)
        else:
            try:
                os.remove(path)
            except Exception:
                print("Failed to remove %s" % path)

    if rmdir:
        try:
            os.rmdir(d)
        except Exception:
            try:
                dir_util.remove_tree(d)
            except Exception:
                print("Failed to remove %s" % d)


def removeLBAndHBcomponents(target_folder=None):
    if not target_folder:
        UOFolders = folders.ClusterFolders
    else:
        UOFolders = [target_folder]

    for folder in UOFolders: 
        fileNames = os.listdir(folder)
        
        print 'Removing Ladybug + Honeybee Components!'
        for fileName in fileNames:
            # check for ladybug userObjects and delete the files
            if fileName.StartsWith('Ladybug') or fileName.StartsWith('Honeybee') \
                    or fileName.StartsWith('LB-') or fileName.StartsWith('HB-'):
                
                fullPath = os.path.join(folder, fileName)
                
                if os.path.isdir(fullPath):
                    removeLBAndHBcomponents(fullPath)
                else:
                    os.remove(fullPath)


def removeLBAndHBpackages(target_folder=None):
    if target_folder is None:
        try:
            target_folder = [p for p in sys.path if p.find('scripts')!= -1][0]
        except IndexError:  # there is no scripts in path try to find plugins folder
            try:
                target_folder = [p for p in sys.path if p.find(r'settings\lib')!= -1][0]
            except IndexError:
                try:  # we might be on a Mac
                    target_folder = [p for p in sys.path if p.find(r'Lib')!= -1][0]
                except IndexError:
                    raise IOError(
                        'Failed to find a shared path in sys.path to install honeybee.\n' \
                         'Make sure Grasshopper is installed correctly!')
    
    for folderName in os.listdir(target_folder):
        if folderName.lower().StartsWith('ladybug') or folderName.lower().StartsWith('honeybee'):
            fullPath = os.path.join(target_folder, folderName)
            nukedir(fullPath, True)


if _removeHB:
    removeLBAndHBcomponents()
    removeLBAndHBpackages()
# ---------- end removehb ----------
