# Grasshopper definition Render_Water_Cube_with_Honeybee.gh (Grasshopper 0.9.76)
# plug-ins: Python Interpreter, Ironbug

honeybee = Honeybee_Honeybee()  # -> Vviiiiiiiiiizzz; plug-in component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
ladybug = Ladybug_Ladybug()  # -> Vviiiiiiiiiizzz; plug-in component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
box = DomainBox(Base=PlaneXY(0, 0, 0), X="4", Y="12", Z="3.6")
panel = Panel("https://www.energyplus.net/weather-download/north_and_central_america_wmo_region_4/USA/TN/USA_TN_Nashville.Intl.AP.723270_TMY3/all")
radparameters = Honeybee_RADParameters(quality=Slider(1, range=0..1))  # -> readMe, radParameters; plug-in component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
epw_stat = Ladybug_OpenEPWAndSTATWeatherFiles(weatherFileURL=panel)  # -> epwFile, statFile; plug-in component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
createhbsrfs = Honeybee_createHBSrfs(geometry=box, srfName="water_cube", RADMaterial="water")  # -> readMe, simplify(HBSurface); plug-in component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
genclimatebasedsky = Honeybee_GenerateClimateBasedSky(weatherFile=epw_stat.epwFile, month="9", day="21", hour="9")  # -> radiationValues, skyFilePath; plug-in component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
imagebasedsimulation = Honeybee_ImageBasedSimulation(skyFile=genclimatebasedsky.skyFilePath, simulationType=2, radParameters=radparameters.radParameters, backupImages=0)  # -> analysisRecipe; plug-in component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
toggle = BooleanToggle(False)

panel_2 = Panel("""void texfunc wavy
6 wave_x wave_y wave_z wave.cal -s .05
0
1 .25""")
# You need to copy wave.cal to c:\radiance\lib
# http://www.arch.mcgill.ca/prof/reinhart/software/Radiance/HowToModelWater.html
panel_3 = Panel("""wavy glass water
0
0
3 0.51 0.62 0.72""")
toggle_2 = BooleanToggle(True)
addtolibrary = Honeybee_AddToRadianceLibrary(RADMaterial=[panel_2, panel_3], addToProjectLib=toggle_2, overwrite=toggle_2, addToHoneybeeLib=False)  # -> readMe; plug-in component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
panel_4 = Panel(addtolibrary)

rundaylightanalysis = Honeybee_RunDaylightSimulation(
    HBObjects=flatten(createhbsrfs.HBSurface),
    analysisRecipe=imagebasedsimulation,
    writeRad=toggle,
    runRad=toggle,
    numOfCPUs=Slider(3, range=0..10),
    radFileName="water_cube",
    overwriteResults=True)  # -> readMe, analysisType, resultsUnit, results, testPts, resultFiles, radGeoFile, studyFolder, done; plug-in component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
hdr_tif = Honeybee_ConvertHDRToTIF(HDRFilePath=rundaylightanalysis.resultFiles, adjustExposure=Toggle(True))  # -> TIFFFilePath; plug-in component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
viewer = Ladybug_ImageViewer(ImagePath_=hdr_tif, _scale_=Slider(1, range=0..1), DisableClickable=False, SaveImgWithCoords=False, scale=1)  # -> ImagePath, Colors, GIF
