# Dynamo graph 03_sunlighthoursAnalysis.dyn (Dynamo 1.3.0.875)

code_block = CodeBlock { 1; }
watch = Watch()  # unwired: arg0
file_path = Filename("..\..\..\..\..\..\EnergyPlusV8-6-0\WeatherData\USA_CA_San.Francisco.Intl.AP.724940_TMY3.epw")

# group: Import location data from epw file
import_location = Custom[Import Location](epwFile=file_path)  # Import location data from an epw weather file

code_block_2 = CodeBlock { 6; }
code_block_3 = CodeBlock { 7..20; }

# group: Calculate hours of the year for sunpath
calculate_hoy = Custom[Calculate HOY](month=code_block_2, hour=code_block_3)  # Calculate hour of year for a month, day and hour

code_block_4 = CodeBlock { 0.3; }
sunPath = Custom[SunPath](location=import_location.location, hoys=calculate_hoy.hoy, scale=code_block_4)  # Use this component to make a 3D sun-path (aka. sun plot). The component also outputs sun vectors that can be used for solar access analysis or shading design. -
watch_2 = Watch(sunPath.vectors)
watch_3 = Watch(sunPath.ERRReport)

# group: Create test geometries!
XY = Plane.XY()
code_block_5 = CodeBlock { 100; }
byWidthLength = Rectangle.ByWidthLength(plane=XY, width=code_block_5, length=code_block_5)
byPatch = Surface.ByPatch(byWidthLength)
byCoordinates = Point.ByCoordinates()
YAxis = Vector.YAxis()
code_block_6 = CodeBlock { 45; }
rotate = Geometry.Rotate(geometry=byWidthLength, origin=byCoordinates, axis=YAxis, degrees=code_block_6)
byPatch_2 = Surface.ByPatch(rotate)
code_block_7 = CodeBlock { 0.5; }
scale = Geometry.Scale(geometry=byPatch_2, xamount=code_block_7, yamount=code_block_7, zamount=code_block_7)

create = List.Create(byPatch, scale)

# group: Generate test points! In case you don't see the test points re-run the node.
number_of_segments = CodeBlock { 2.5; }
distance_from_base = CodeBlock { 0.1; }

create_2 = List.Create(byWidthLength, rotate)
generate_test_points_by_grid = Custom[Generate Test Points by Grid Size](testSurfaces=create, gridSize=number_of_segments, disFromSurface=distance_from_base, borders=create_2)  # Generate test points from Dynamo surfaces based on grid size.
byPatch_3 = Surface.ByPatch(generate_test_points_by_grid.polygons)
analysis_grid = Custom[Analysis Grid](testPoints=generate_test_points_by_grid.testPts, ptsVectors=generate_test_points_by_grid.ptsNormal)  # Analysis Grid. -
solar_access_recipe = Custom[Solar Access Recipe](sunVectors=sunPath.vectors, hoys=sunPath.hoys, analysisGrids=analysis_grid.analysisGrid)  # Solar Access Recipe. -
honeybee_surface = Custom[Honeybee Surface](geo=create)  # Honeybee Surface -
code_block_8 = CodeBlock { "c:/ladybug"; "dynamo_example_simple"; true; }
boolean = BoolSelector(false)
run_radiance_analysis = Custom[Run Radiance Analysis](analysisRecipe=solar_access_recipe.analysisRecipe, HBObjects=honeybee_surface.HBSrf, folder=code_block_8.out0, name=code_block_8.out1, write=code_block_8.out2, run=boolean)  # Run Radiance Analysis -
cumulative_value = Custom[Cumulative Value](analysisGrid=run_radiance_analysis.outputs)  # Mass addition of values for a grid. This component is mostly useful for solar access and radiation studies. -

# group: Create legend parameters
code_block_9 = CodeBlock { 6; }

color_range = Custom[Color Range](index=code_block_9)  # Use this component to access a library of typical gradients useful throughout Ladybug. The output from this component should be plugged into the colors_ input of the "Legend Parameters" component. For an image of each of the gardients in the library, check here: https://github.com/mostaphaRoudsari/ladybug/blob/master/resources/gradients.jpg -

# group (continued): Create legend parameters
legend_parameters = Custom[Legend Parameters](colors=color_range.colors)  # Use legend parameter to set up results visualization setting

generate_colors = Custom[Generate Colors](values=cumulative_value.values, legendPar=legend_parameters.legendPar)  # Use this component to generate colors based on values and legend parameters. -
byGeometryColor = Display.Display.ByGeometryColor(byPatch_3, generate_colors.colors)
