# Grasshopper definition Surface_by_surface_geometry_preparation_for_daylight_simulation_II.gh (Grasshopper 0.9.76)
# plug-ins: Python Interpreter

ladybug = Ladybug_Ladybug()  # -> Vviiiiiiiiiizzz; plug-in component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
honeybee = Honeybee_Honeybee()  # -> Vviiiiiiiiiizzz; plug-in component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
panel = Panel("https://www.energyplus.net/weather-download/europe_wmo_region_6/FRA//FRA_Paris.Orly.071490_IWEC/all")
radopaquematerial = Honeybee_RadianceOpaqueMaterial(materialName="generic_35", RReflectance=".35", GReflectance=".35", BReflectance=".35", roughness=0.05, specularity=0)  # -> avrgRef, RADMaterial; plug-in component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
epw_stat = Ladybug_OpenEPWAndSTATWeatherFiles(weatherFileURL=panel)  # -> epwFile, statFile; plug-in component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
ledge = Brep(<brep referenced from the Rhino model>)

# ---- group: glass facade
glass = Brep(<brep referenced from the Rhino model>)

# ----
radglassmaterial = Honeybee_RadianceGlassMaterial(materialName="glass_.65", RTransmittance=".65", GTransmittance=".65", BTransmittance=".65", refractiveIndex=1.52)  # -> avrgTrans, RADMaterial; plug-in component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

# ---- group: furniture
furniture = Brep([<brep referenced from the Rhino model> x12])

# ---- group: floor
floor = Brep(<brep referenced from the Rhino model>)

# ---- group: ceiling
ceiling = Brep([<brep referenced from the Rhino model> x2])

# ----
walls = Brep([<brep referenced from the Rhino model> x2])
number_slider = Slider(45, range=0..100)
importlocation = Ladybug_ImportLocation(epwFile=epw_stat.epwFile)  # -> location; plug-in component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
# Geometry Preparation
panel_2 = Panel("0")
# Assign specific materials
createhbsrfs = Honeybee_createHBSrfs(geometry=[ledge, furniture], RADMaterial=radopaquematerial.RADMaterial)  # -> readMe, simplify(HBSurface); plug-in component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
createhbsrfs_2 = Honeybee_createHBSrfs(geometry=glass, RADMaterial=radglassmaterial.RADMaterial)  # -> readMe, simplify(HBSurface); plug-in component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
createhbsrfs_3 = Honeybee_createHBSrfs(geometry=floor, srfType="2")  # -> readMe, simplify(HBSurface); plug-in component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
createhbsrfs_4 = Honeybee_createHBSrfs(geometry=ceiling, srfType="3")  # -> readMe, simplify(HBSurface); plug-in component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
genclimatebasedsky = Honeybee_GenerateClimateBasedSky(north=number_slider, weatherFile=epw_stat.epwFile, month="12", day="21", hour="12")  # -> radiationValues, skyFilePath; plug-in component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
# Honeybee default materials will be assigned
# based on surface type
createhbsrfs_5 = Honeybee_createHBSrfs(geometry=walls, srfType=panel_2)  # -> readMe, simplify(HBSurface); plug-in component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
northarrow = Ladybug_North(north=number_slider, scale=".05")  # -> northSign; plug-in component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
explodelocation = Ladybug_DecomposeLocation(location=importlocation)  # -> locationName, latitude, longitude, timeZone, elevation; plug-in component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
test_surfaces = Brep(<brep referenced from the Rhino model>)
gentestpts = Honeybee_GenerateTestPoints(testGeometry=test_surfaces, gridSize=Slider(0.3, range=0..1), distBaseSrf=".762", moveTestMesh=True)  # -> readMe, simplify(testPoints), simplify(ptsVectors), simplify(facesArea), simplify(mesh); plug-in component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
radparameters = Honeybee_RADParameters(quality=0, ab="3")  # -> readMe, radParameters; plug-in component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
doy_hoy = Ladybug_DOY_HOY(days="21", months="12", hours="12")  # -> HOY, DOY, date; plug-in component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

# ---- group: collect all honeybee surfaces
brep = Brep(flatten([createhbsrfs_5.HBSurface, createhbsrfs_4.HBSurface, createhbsrfs_3.HBSurface, createhbsrfs.HBSurface, createhbsrfs_2.HBSurface]))

# ----
# Analysis Recipe
gridbasedsimulation = Honeybee_GridBasedSimulation(
    skyFile=genclimatebasedsky.skyFilePath,
    testPoints=gentestpts.testPoints,
    ptsVectors=gentestpts.ptsVectors,
    testMesh=gentestpts.mesh,
    simulationType=0,
    radParameters=radparameters.radParameters)  # -> analysisRecipe; plug-in component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
toggle = BooleanToggle(True)
# Run the analysis
rundaylightanalysis = Honeybee_RunDaylightSimulation(
    HBObjects=flatten(brep),
    analysisRecipe=gridbasedsimulation,
    writeRad=toggle,
    runRad=toggle,
    numOfCPUs="4",
    radFileName=doy_hoy.date,
    overwriteResults=True)  # -> readMe, analysisType, resultsUnit, illuminance_values, testPts, illuminance_files, radGeoFile, studyFolder, done; plug-in component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
panel_3 = Panel(rundaylightanalysis.studyFolder)
gradientlibrary = Ladybug_GradientLibrary(gradIndex="1")  # -> customColors; plug-in component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
legendpar = Ladybug_LegendParameters(lowBound="0", highBound="500", customColors=flatten(gradientlibrary))  # -> legendPar; plug-in component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

# ---- group: Study Title
merge = Merge(
    Data2=flatten(rundaylightanalysis.analysisType),
    Data3=flatten(doy_hoy.date),
    Data4=flatten(explodelocation.locationName))
join = TextJoin(Text=merge)

# ----
dom = ConstructDomain(DomainStart="-.5", DomainEnd=".5")
panel_4 = Panel(join)
# Result Visualization
recolormesh = Ladybug_RecolorMesh(
    analysisResult=rundaylightanalysis.illuminance_values,
    inputMesh=gentestpts.mesh,
    heightDomain=dom,
    legendPar=legendpar,
    analysisTitle=join,
    legendTitle=rundaylightanalysis.resultsUnit)  # -> readMe, newMesh, newLegend, legendBasePt, meshColors, legendColors; plug-in component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
