# Grasshopper definition Update_Ladybug_and_Honeybee.gh (Grasshopper 0.9.76)
# plug-ins: Python Interpreter

ladybug = Ladybug_Ladybug()  # -> Vviiiiiiiiiizzz; plug-in component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
honeybee = Honeybee_Honeybee()  # -> Vviiiiiiiiiizzz; plug-in component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
toggle = BooleanToggle(True)
updateladybug = Ladybug_UpdateLadybug(updateAllUObjects=toggle)  # -> readMe; plug-in component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
updatehoneybee = Honeybee_UpdateHoneybee(updateAllUObjects=toggle)  # -> readMe; plug-in component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
panel = Panel(updateladybug)
panel_2 = Panel(updatehoneybee)
