# Grasshopper definition View_Rose.gh (Grasshopper 0.9.76)
# plug-ins: Python Interpreter

crv = Curve(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)
eval = EvaluateCurve(Curve=reparameterize(crv), Parameter=Slider(0.35, range=0..1))  # -> Point, Tangent, Angle
preview = CustomPreview(Geometry=crv, Shader=ColourSwatch(SwatchColor=RGB(0, 0, 0)))
pt = Point(eval.Point)
ladybug = Ladybug_Ladybug()  # -> Vviiiiiiiiiizzz; plug-in component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
pl = PlaneNormal(Origin=pt, ZAxis=Vector(0, 0, 1))
brep = Brep([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])
viewrose = Ladybug_viewRose(context=brep, plane=pl, radius=Slider(677, range=0..1000))  # -> readMe, viewRose, blocked, visibleAngle; plug-in component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
panel = Panel(viewrose.readMe)
panel_2 = Panel(viewrose.visibleAngle)
lng = ListLength(List=viewrose.blocked)
lng_2 = ListLength(List=viewrose.viewRose)
preview_2 = CustomPreview(Geometry=viewrose.viewRose, Shader=ColourSwatch(SwatchColor=RGB(255, 255, 0)))
random = Random(Range=Domain(0, 1), Number=lng_2, Seed=2)
random_2 = Random(Range=Domain(0, 1), Number=lng, Seed=random)
gradient = Gradient(
    LowerLimit=0,
    UpperLimit=1,
    Parameter=random_2,
    stops=[0: RGB(234, 38, 0), 0.25: RGB(234, 126, 0), 0.5: RGB(254, 244, 84), 0.75: RGB(173, 203, 249), 1: RGB(75, 107, 169)])
material = CreateMaterial(Diffuse=gradient, Specular=RGB(255, 255, 255), Emission=RGB(0, 0, 0), Transparency=Slider(0.5, range=0..1), Shine=0)
boundary = BoundarySurfaces(Edges=viewrose.blocked)
preview_3 = CustomPreview(Geometry=boundary, Shader=material)
