# Grasshopper definition locate_coffee_shops_based_on_outdoor_comfort.gh (Grasshopper 0.9.76)
# plug-ins: Python Interpreter

ladybug = Ladybug_Ladybug()  # -> Vviiiiiiiiiizzz; plug-in component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
panel = Panel("https://www.energyplus.net/weather-download/north_and_central_america_wmo_region_4/USA/NY/USA_NY_New.York.City-Central.Park.744860_TMY2/all")
epw_stat = Ladybug_OpenEPWAndSTATWeatherFiles(weatherFileURL=panel)  # -> epwFile, statFile; plug-in component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

# ---- group: area that outdoor seats are permitted
crv = Curve([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])

# ---- group: context as joines mesh
mesh = Mesh(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)

# ----
# Import Weather Data
importepw = Ladybug_ImportEpw(epwFile=epw_stat.epwFile)  # -> readMe, latitude, location, dryBulbTemperature, dewPointTemperature, relativeHumidity, windSpeed, windDirection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; plug-in component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
preview = CustomPreview(Geometry=mesh, Shader=ColourSwatch(SwatchColor=RGBA(255, 255, 255, 123)))
curvepoint = PointOnCurve(crv, parameter=0.5)
analysisperiod = Ladybug_AnalysisPeriod()  # -> readMe, analysisPeriod; plug-in component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
flatten = FlattenTree(Tree=curvepoint, Path="{0}")
importepw_2 = Ladybug_ImportEpw(epwFile=epw_stat.epwFile)  # -> readMe, latitude, location, dryBulbTemperature, dewPointTemperature, relativeHumidity, windSpeed, windDirection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; plug-in component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
# Adjust Temperature
solaradjusttemperature = Ladybug_OutdoorSolarTemperatureAdjustor(
    location=importepw_2.location,
    cumSkyMtxOrDirNormRad=importepw_2.directNormalRadiation,
    diffuseHorizRad=importepw_2.diffuseHorizontalRadiation,
    baseTemperature=importepw_2.dryBulbTemperature,
    horizInfraredRad=importepw_2.horizontalInfraredRadiation,
    bodyLocation=flatten,
    contextShading=mesh,
    analysisPeriodOrHOY=analysisperiod.analysisPeriod,
    parallel=Toggle(True),
    runIt=Toggle(True))  # -> readMe, port, effectiveRadiantField, MRTDelta, solarAdjustedMRT, port_2, mannequinMesh, port_3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; plug-in component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
analysisperiod_2 = Ladybug_AnalysisPeriod(fromHour="7", toHour="20")  # -> readMe, analysisPeriod; plug-in component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
# Calculate outdoor comfort
outdoorcomfortcalculator = Ladybug_OutdoorComfortCalculator(
    dryBulbTemperature=importepw_2.dryBulbTemperature,
    meanRadiantTemperature=solaradjusttemperature.solarAdjustedMRT,
    windSpeed_tenMeters=importepw_2.windSpeed,
    relativeHumidity=importepw_2.relativeHumidity,
    analysisPeriod=analysisperiod_2.analysisPeriod,
    runIt=Toggle(True))  # -> readMe, port, universalThermalClimateIndex, comfortableOrNot, thermalStress, conditionOfPerson, port_2, percentOfTimeComfortable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; plug-in component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
bnd = Bounds(Numbers=flatten(outdoorcomfortcalculator.percentOfTimeComfortable))
bnd_2 = Bounds(Numbers=flatten(outdoorcomfortcalculator.percentHeatStress))

# ---- group: Assuming that we can remove heat stress by designing a good shade. This is an overestimate.
addition = Addition(A=outdoorcomfortcalculator.percentOfTimeComfortable, B=outdoorcomfortcalculator.percentHeatStress)  # -> flatten(Result)
bnd_3 = Bounds(Numbers=flatten(addition))

# ----
panel_2 = Panel(bnd)
panel_3 = Panel(bnd_2)

# ---- group: result visualization
number_slider = Slider(1, range=0..1)
number_slider_2 = Slider(100, range=0..100)
cir = Circle(Plane=flatten, Radius=Slider(2, range=0..10))
dom = ConstructDomain(DomainStart=number_slider, DomainEnd=number_slider_2)
remap = RemapNumbers(Value=addition, Source=bnd_3, Target=dom)  # -> Mapped, Clipped
# Visualize results
crv_2 = Curve(cir)
Z = UnitZ(Factor=remap.Mapped)
gradient = Gradient(
    LowerLimit=number_slider_2,
    UpperLimit=number_slider,
    Parameter=remap.Mapped,
    stops=[0: RGB(0, 128, 0), 0.5: RGB(255, 255, 0), 1: RGB(255, 0, 0)])
extr = Extrude(Base=crv_2, Direction=Z)
cap = CapHoles(Brep=extr)
preview_2 = CustomPreview(Geometry=cap, Shader=gradient)

# ---- group: added circles for plan view
dom_2 = ConstructDomain(DomainStart=Slider(1, range=0..1), DomainEnd=Slider(44, range=0..100))
remap_2 = RemapNumbers(Value=addition, Source=bnd_3, Target=dom_2)  # -> Mapped, Clipped
cir_2 = Circle(Plane=flatten, Radius=remap_2.Mapped)
boundary = BoundarySurfaces(Edges=cir_2)
material = CreateMaterial(Diffuse=gradient, Specular=RGB(255, 255, 255), Emission=RGB(0, 0, 0), Transparency=Slider(0.6, range=0..1), Shine=0)
preview_3 = CustomPreview(Geometry=boundary, Shader=material)
